# Grasshopper definition modelSpace.gh (Grasshopper 1.0.7)
# plug-ins: Urbano, Shortest Walk in Gh

int_length_of_newline_km = Slider(1, range=0..3)
int_depating_borough = Slider(0, range=0..10)
int_destination_borough = Slider(2, range=0..10)
walking_speed_m_min = Panel("70")
average_subway_speed_m_min = Panel("300")
crv_exsisting_subway_line = Curve([<curve referenced from the Rhino model> x200])
pt_list_of_boroughs = Point([<point referenced from the Rhino model> x11])
crv_road_networks = Curve([<curve referenced from the Rhino model> x5000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])
int_destination_borough_2 = Integer(int_destination_borough)
# Morningside Heights
# Upper West Side
# Harlem
# East Harlem
# Upper East Side
# Hell's Kitchen
# West Village
# Times Square
# Financial District
# Lower East Side
# East Village
int_depating_borough_2 = Integer(int_depating_borough)
multiplication = Multiplication(A=int_length_of_newline_km, B="1000")
lng = ListLength(List=pt_list_of_boroughs)
lng_2 = ListLength(List=pt_list_of_boroughs)
series = Series(Start=0, Step=1, Count=lng_2)
series_2 = Series(Start=0, Step=1, Count=lng)
item = ListItem(List=pt_list_of_boroughs, Index=int_destination_borough_2, Wrap=True)
# Prepare input
item_2 = ListItem(List=pt_list_of_boroughs, Index=int_depating_borough_2, Wrap=True)
crossref = CrossReference(ListA=series_2, ListB=series, CrossMode=3)  # -> ListA, ListB
cir = Circle(Plane=item_2, Radius=expr("X*1.1", multiplication))
item_3 = ListItem(List=pt_list_of_boroughs, Index=crossref.ListA, Wrap=True)
item_4 = ListItem(List=pt_list_of_boroughs, Index=crossref.ListB, Wrap=True)
num_walking_speed_m_min = Number(walking_speed_m_min)
average_subway_speed_m_min_2 = Number(average_subway_speed_m_min)
boundary = BoundarySurfaces(Edges=cir)
scx = SurfaceCurve(Surface=graft(boundary), Curve=crv_road_networks)  # -> Curves, Points, UVPoints, Normals, Parameters, Tangents
splitstr = SplitStreetCurves(SplitStreetCurves=flatten(scx.Curves), IntersectionTolerance=1e-12)  # -> simplify(graft(ProcessedStreetCurves)), Metadata
len = Length(Curve=splitstr.ProcessedStreetCurves)
division = Division(A=len, B="200")
max = Maximum(A=division, B="1")
divide = DivideCurve(Curve=splitstr.ProcessedStreetCurves, Count=max, Kinks=False)  # -> Points, Tangents, Parameters
multiplication_2 = Multiplication(A=multiplication, B="0.95")
pt_departing_station = Point(graft(item_2))
shatter = Shatter(Curve=splitstr.ProcessedStreetCurves, Parameters=divide.Parameters)  # -> flatten(Segments)
end = EndPoints(Curve=shatter)  # -> Start, End
pt_line_end_point = Point(end.Start)
pt_towards = Point(item)
dist = Distance(PointA=pt_departing_station, PointB=pt_line_end_point)
larger = LargerThan(FirstNumber=dist, SecondNumber=multiplication_2)  # -> LargerThan, OrEqualTo
cull = CullPattern(List=pt_line_end_point, CullPattern=larger.OrEqualTo)
dist_2 = Distance(PointA=cull, PointB=pt_towards)
ln = Line(StartPoint=pt_departing_station, EndPoint=cull)
sort = SortList(Keys=dist_2, ValuesA=cull)  # -> Keys, ValuesA
item_5 = ListItem(List=sort.ValuesA, Index=0, Wrap=True)
ln_2 = Line(StartPoint=pt_departing_station, EndPoint=item_5)
crv_exsisting_subway_line_2 = Curve(crv_exsisting_subway_line)
shortwalk = ShortestWalk(Curves=shatter, WantedPath=ln_2)  # -> ShortestWalk, Succession, Direction, Length
crv_new_subway_line = Curve(shortwalk.ShortestWalk)
merge = Merge(Data1=crv_new_subway_line, Data2=crv_exsisting_subway_line_2)  # -> flatten(Result)
crv_new_whole_subway_line = Curve(merge)
crv_new_whole_subway_line_2 = Curve(crv_new_whole_subway_line)
pull = PullPoint(Point=item_4, Geometry=crv_new_whole_subway_line_2, ClosestOnly=True)  # -> ClosestPoint, Distance
pull_2 = PullPoint(Point=item_3, Geometry=crv_new_whole_subway_line_2, ClosestOnly=True)  # -> ClosestPoint, Distance
ln_3 = Line(StartPoint=item_3, EndPoint=pull_2.ClosestPoint)
ln_4 = Line(StartPoint=item_4, EndPoint=pull.ClosestPoint)
splitstr_2 = SplitStreetCurves(SplitStreetCurves=flatten(crv_new_whole_subway_line_2), IntersectionTolerance=1e-12)  # -> simplify(graft(ProcessedStreetCurves)), Metadata
len_2 = Length(Curve=splitstr_2.ProcessedStreetCurves)
division_2 = Division(A=len_2, B="100")
max_2 = Maximum(A=division_2, B="1")
divide_2 = DivideCurve(Curve=splitstr_2.ProcessedStreetCurves, Count=max_2, Kinks=False)  # -> Points, Tangents, Parameters
shatter_2 = Shatter(Curve=splitstr_2.ProcessedStreetCurves, Parameters=divide_2.Parameters)  # -> flatten(Segments)
ln_5 = Line(StartPoint=pull_2.ClosestPoint, EndPoint=pull.ClosestPoint)
item_6 = ListItem(List=shatter_2, Index=0, Wrap=True)
shortwalk_2 = ShortestWalk(Curves=shatter_2, WantedPath=ln_5)  # -> ShortestWalk, Succession, Direction, Length
python = GhPythonScript(input_list=shortwalk_2.ShortestWalk)  # -> out, refined_tree; inputs input_list: list
# ---------- python: Python ----------
import Grasshopper as gh
import ghpythonlib.treehelpers as th
import math
import Rhino.Geometry as rg

refined_list = []
number_of_points = int(math.sqrt(len(input_list)))+1

for i in range(int(number_of_points)):
    temp= []
    for j in range(int(number_of_points)-1):                    
        temp.append(input_list[i*(int(number_of_points)-1)+j])
#        print(i*(int(number_of_points)-1)+j)
    print(i)
    nullline=rg.LineCurve(rg.Point3d(0,0,0),rg.Point3d(0,0,0))
    temp.insert(i,nullline)       
    
    refined_list.append(temp)
    refined_tree= th.list_to_tree(refined_list,source=[0])
# ---------- end python ----------
python_2 = GhPythonScript(input_list=ln_3)  # -> out, refined_tree; inputs input_list: list; same code as python
python_3 = GhPythonScript(input_list=ln_4)  # -> out, refined_tree; inputs input_list: list; same code as python
crv_way_on_subway = Curve(python.refined_tree)
crv_walking_1 = Curve(python_2.refined_tree)
crv_walking_2 = Curve(python_3.refined_tree)
len_3 = Length(Curve=crv_way_on_subway)
len_4 = Length(Curve=crv_walking_1)
len_5 = Length(Curve=crv_walking_2)
num_subway_distance = Number(len_3)
average_subway_speed_m_min_3 = Number(average_subway_speed_m_min_2)
num_walking_speed_m_min_2 = Number(num_walking_speed_m_min)
num_walking_distance_1 = Number(len_4)
num_walking_distance_2 = Number(len_5)
division_3 = Division(A=num_walking_distance_1, B=num_walking_speed_m_min_2)
division_4 = Division(A=num_subway_distance, B=average_subway_speed_m_min_3)
division_5 = Division(A=num_walking_distance_2, B=num_walking_speed_m_min_2)
addition = Addition(A=division_3, B=division_4, C=division_5)
ma = MassAddition(Input=addition)  # -> Result, PartialResults
num_travel_time_from_a_point = Number(flatten(ma.Result))
crv_new_subway_line_2 = Curve(crv_new_subway_line)
avr = Average(Input=num_travel_time_from_a_point)
pipe = Pipe(Curve=crv_new_subway_line_2, Radius=Slider(20, range=0..30), Caps=0)
subtraction = Subtraction(A=num_travel_time_from_a_point, B=avr)
sqr = Square(Value=subtraction)
avr_2 = Average(Input=sqr)
sqrt = SquareRoot(Value=avr_2)
num_travel_time_from_a_point_2 = Number(ma.Result)
num_standard_deviation_inequality = Number(sqrt)
crv_new_subway_line_3 = Curve(crv_new_subway_line_2)
brep_new_subway_line_pipe = Brep(pipe)
panel = Panel(num_travel_time_from_a_point_2)
